# Grasshopper definition gh_workshop.gh (Grasshopper 1.0.8)

base_size = Slider(2, range=1..10)
vertical_module_height = Slider(2, range=1..10)
rotation_degrees = Slider(24, range=5..30)
# a compoonent for storing point data.
# The data is internalised here
# (stored in the GH component as opposed
# to referencing a point from the Rhino file)
point = Point(Point(0, 0, 0))
vector_xyz = VectorXYZ(XComponent=0, YComponent=base_size, ZComponent=0)  # -> Vector, Length
vector_xyz_2 = VectorXYZ(XComponent=base_size, YComponent=0, ZComponent=0)  # -> Vector, Length
# "Move" acts as a copy,
# as the output of each component in GH
# can be dispayed or exported separately.
# The same applies to other transformations.
move = Move(Geometry=point, Motion=vector_xyz_2.Vector)  # -> Geometry, Transform
move_2 = Move(Geometry=point, Motion=vector_xyz.Vector)  # -> Geometry, Transform
move_3 = Move(Geometry=move.Geometry, Motion=vector_xyz.Vector)  # -> Geometry, Transform
# "Merge" combines multiple
# data streams into 1 list.
# You can just connect multiple commponents
# to an input instead but "Merge"
# is helpful for keeping track of the order
# and readibility.
merge = Merge(Data1=point, Data2=move.Geometry, Data3=move_3.Geometry, Data4=move_2.Geometry)
# "Point list" displays point indices next to points.
# It can be helpful to know
# e.g. the direction of a curve.
panel = Panel("1")
# Panels can be helpful for previewing data.
panel_2 = Panel(merge)
point_list = PointList(Points=merge, Size=panel)
polyline = PolyLine(Vertices=merge, Closed="True")
# We can use a series to perform mathematical operations.
# It can be a substitute for a loop.
# Here, we're getting
# a series of vectors used
# to get multiple copies of an object.
# 
# For actual loops, have a look at a plugin
# called Anemone, or the built-in
# Python or C# code snippet components.
series = Series(Start=0, Step=1, Count=10)
unit_z = UnitZ(Factor=vertical_module_height)
multiplication = Multiplication(A=unit_z, B=series)
panel_3 = Panel(multiplication)
panel_4 = Panel(series)
move_4 = Move(Geometry=polyline, Motion=multiplication)  # -> Geometry, Transform
area = Area(Geometry=move_4.Geometry)  # -> Area, Centroid
multiplication_2 = Multiplication(A=rotation_degrees, B=series)
panel_5 = Panel(multiplication_2)
# When you right-click the component
# input or output, you can often see
# options to edit the data.
# Here, for example, wer're casting the "Angle"
# input to degrees (it's radians by default).
rotate = Rotate(Geometry=move_4.Geometry, Angle=degrees(multiplication_2), Plane=area.Centroid)  # -> Geometry, Transform
loft_options = LoftOptions(Closed="False", Adjust=False, Rebuild=0, Refit=0, Type=2)
# "Loft" creates a NURBS surface
# from an ordered list of curves.
loft = Loft(Curves=rotate.Geometry, Options=loft_options)
custom_mesh_settings = SettingsCustom(
    StitchSeams=True,
    SimplePlanes="True",
    Refine=True,
    MinCount=16,
    MaxCount=400,
    AspectRatio=20,
    MaxDistance=0,
    MaxAngle=20,
    MinEdge=0,
    MaxEdge=0)
# Make the surface into a solid.
cap_holes_ex = CapHolesEx(Brep=loft)  # -> Brep, Caps, Solid
# Turn the NURBS geometry into a Mesh.
# This will output a Mesh with quadrangular faces.
# 
# Quad faces may not be optimal for further processing
# as the faces are not always planar
# (have all the vertices in the same plane).
# That's why we may want to triangulate it.
# Triangular faces are always planar.
mesh_brep = MeshBrep(Brep=cap_holes_ex.Brep, Settings=custom_mesh_settings)
# Triangulate the Mesh.
tri = Triangulate(Mesh=mesh_brep)  # -> Mesh, Count
